vi "index.gviweb"   [LabVIEW NXG 5.0.0]
panel controls:
  "RelayControls": bool[]
panel indicators:
  "Connected?": bool
uses:
  WebApp::GetHostname.jsli::GetHostname
  NI::WebSockets::Close WebSocket.gvi
  NI::G Core::Error::Clear Error Cluster.gvi
  NI::WebSockets::Open WebSocket.gvi
  WebApp::ConvertToBinary.gviweb
  NI::WebSockets::Write Binary.gvi
diagram:
  call "GetHostname"() -> (return=w1, error out=w2)
  Format Into String(formatString="ws://%s:6123", errIn=w2, w1) -> (outString=w3, errOut=w4)
  s1 = "Initialise"  # shift register
  s2 = uninitialised  # shift register
  while {
    # s1: States
    # w3: WebSocketURL
    # s2: WebSocket connection
    # w4: Error
    case (s1) {
      frame "Initialise", Default {
        w5 = s2
        w6 = "Connect"
      }
      frame "Connect" {
        call "Close WebSocket.gvi"(websocket session in=s2, error in=w4) -> (error out=w7)
        call "Clear Error Cluster.gvi"(error in=w7) -> (error out=w8)
        call "Open WebSocket.gvi"(url=w3, error in=w8) -> (websocket session out=w5, error out=w9)
        Select(s=w9, t="Connect", f="Write Data") -> w6
        Not(x=w9) -> w10
        $"Connected?" <- w10
        Wait(time to wait=250)
      }
      frame "Write Data" {
        call "ConvertToBinary.gviweb"(RelayControls=$RelayControls) -> (BinaryRelayControls=w11)
        call "Write Binary.gvi"(websocket session in=s2, binary message=w11, error in=w4) -> (websocket session out=w5, error out=w12)
        Select(s=w12, t="Connect", f="Write Data") -> w6
        Wait(time to wait=50)
      }
    }
    next s1 = w6
    next s2 = w5
    stop if FALSE
  }
